# Grasshopper definition CompositeI-GriderBridge.gh (Grasshopper 1.0.8)
# plug-ins: Friends, Structure

number_slider = Slider(1200, range=0..1500)
number_slider_2 = Slider(25, range=0..100)
number_slider_3 = Slider(500, range=0..1000)
number_slider_4 = Slider(16, range=0..100)
division = Division(A=number_slider, B=Slider(1000, range=0..1000))
yz_plane = YZPlane(Origin=Point(0, 0, 0))
division_2 = Division(A=division, B=Slider(2, range=0..10))
construct_point = ConstructPoint(XCoordinate=0, YCoordinate=0, ZCoordinate=division_2)
python_3_script = Python3Script(h=number_slider, b=number_slider_3, tf=number_slider_2, tw=number_slider_4, r=Slider(0, range=0..100), P=yz_plane)  # -> S; inputs h: Double, b: Double, tf: Double, tw: Double, r: Double, P: Plane
# ---------- python_3_script: Python ----------
import Rhino.Geometry as rg
import math

# ---- GH inputs: h, b, tw, tf, r (mm), P (target plane) ----

# mm -> m
h_  = h  / 1000.0
b_  = b  / 1000.0
tw_ = tw / 1000.0
tf_ = tf / 1000.0
r_  = r  / 1000.0

seg = 8          # straight segments per fillet (discretization density)
tol = 1e-9
S = None

hw  = h_ / 2.0
bw  = b_ / 2.0
y_web_top =  hw - tf_     # inner face of top flange
y_web_bot = -hw + tf_     # inner face of bottom flange
xwr =  tw_ / 2.0          # web right face
xwl = -tw_ / 2.0          # web left face

# clamp r so the fillets stay geometrically valid (no self-intersection)
r_max = min(tf_, (b_ - tw_) / 2.0, (h_ - 2.0 * tf_) / 2.0)
if r_ > r_max:
    r_ = max(0.0, r_max)

pts = []
def add(x, y):
    if pts:
        lx, ly = pts[-1][0], pts[-1][1]
        if abs(lx - x) < tol and abs(ly - y) < tol:
            return        # skip duplicate consecutive vertices
    pts.append((x, y, 0.0))

def arc(cx, cy, a0, a1):
    for i in range(seg + 1):
        t = float(i) / seg
        a = a0 + t * (a1 - a0)
        add(cx + r_ * math.cos(a), cy + r_ * math.sin(a))

# ---- trace boundary CCW ----
add(-bw, -hw)                 # bottom-left outer
add( bw, -hw)                 # bottom-right outer
add( bw, y_web_bot)           # up bottom flange right edge

if r_ > tol:
    arc(xwr + r_, y_web_bot + r_, -math.pi/2.0, -math.pi)      # bottom-right root
    arc(xwr + r_, y_web_top - r_,  math.pi,      math.pi/2.0)  # top-right root
else:
    add(xwr, y_web_bot)
    add(xwr, y_web_top)

add( bw, y_web_top)           # along top flange underside
add( bw,  hw)                 # up top flange right edge
add(-bw,  hw)                 # top-left outer
add(-bw, y_web_top)           # down top flange left edge

if r_ > tol:
    arc(xwl - r_, y_web_top - r_,  math.pi/2.0, 0.0)           # top-left root
    arc(xwl - r_, y_web_bot + r_,  0.0,        -math.pi/2.0)   # bottom-left root
else:
    add(xwl, y_web_top)
    add(xwl, y_web_bot)

add(-bw, y_web_bot)           # along bottom flange underside

# ---- closed polyline -> brep ----
poly = rg.Polyline([rg.Point3d(p[0], p[1], p[2]) for p in pts])
if not poly[0].EpsilonEquals(poly[poly.Count - 1], tol):
    poly.Add(poly[0])         # close the loop

crv = poly.ToNurbsCurve()

target = P if isinstance(P, rg.Plane) else rg.Plane.WorldXY
crv.Transform(rg.Transform.PlaneToPlane(rg.Plane.WorldXY, target))

breps = rg.Brep.CreatePlanarBreps(crv)
if breps:
    S = breps[0]
# ---------- end python_3_script ----------
number_slider_5 = Slider(2.1, range=0..10)
panel = Panel("C:\Users\UPCnet\OneDrive\MatchFEM_Examples\CompositeIGirderBridge")
number_slider_6 = Slider(12, range=0..100)
series = Series(Start=number_slider_5, Step=number_slider_5, Count=Slider(2, range=0..10))
unit_y = UnitY(Factor=Slider(6, range=0..10))
unit_y_2 = UnitY(Factor=number_slider_6)
unit_z = UnitZ(Factor=Slider(0.2, range=0..1))
unit_y_3 = UnitY(Factor=number_slider_6)
negative = Negative(Value=unit_y_2)
negative_2 = Negative(Value=unit_y_3)
unit_y_4 = UnitY(Factor=series)
negative_3 = Negative(Value=unit_y_4)
move = Move(Geometry=construct_point, Motion=unit_y)  # -> Geometry, Transform
move_2 = Move(Geometry=move.Geometry, Motion=unit_z)  # -> Geometry, Transform
move_3 = Move(Geometry=move.Geometry, Motion=negative)  # -> Geometry, Transform
move_4 = Move(Geometry=move_2.Geometry, Motion=negative_2)  # -> Geometry, Transform
move_5 = Move(Geometry=python_3_script, Motion=unit_y_4)  # -> Geometry, Transform
move_6 = Move(Geometry=python_3_script, Motion=negative_3)  # -> Geometry, Transform
panel_2 = Panel("""MassDensity
YoungModulus
PoissonRatio""")
panel_3 = Panel("""7800
210000
0.3""")
panel_4 = Panel("""2500
35000
0.2""")
panel_5 = Panel("""MassDensity
YoungModulus
PoissonRatio""")
panel_6 = Panel("""0
100000000
0""")
panel_7 = Panel("""MassDensity
YoungModulus
PoissonRatio""")
unit_x = UnitX(Factor=Slider(20, range=0..100))
brep = Brep(flatten([python_3_script, move_5.Geometry, move_6.Geometry]))
polyline = PolyLine(Vertices=[move.Geometry, move_2.Geometry, move_4.Geometry, move_3.Geometry], Closed=Toggle(True))
boundary_surfaces = BoundarySurfaces(Edges=polyline)
extrude = Extrude(Base=brep, Direction=unit_x)
area = Area(Geometry=brep)  # -> Area, Centroid
move_7 = Move(Geometry=area.Centroid, Motion=unit_x)  # -> Geometry, Transform
extrude_2 = Extrude(Base=boundary_surfaces, Direction=unit_x)
number_slider_7 = Slider(20, range=0..100)
number_slider_8 = Slider(1000, range=0..1000)
line = Line(StartPoint=area.Centroid, EndPoint=move_7.Geometry)
deconstruct_brep = DeconstructBrep(Brep=extrude_2)  # -> Faces, Edges, Vertices
divide_curve = DivideCurve(Curve=line, Count=number_slider_7, Kinks=False)  # -> Points, Tangents, Parameters
division_3 = Division(A=number_slider_2, B=number_slider_8)
division_4 = Division(A=number_slider_4, B=number_slider_8)
division_5 = Division(A=number_slider_3, B=number_slider_8)
move_8 = Move(Geometry=divide_curve.Points, Motion=Vector(0, 0, 10))  # -> Geometry, Transform
division_6 = Division(A=number_slider, B=number_slider_8)
list_item = ListItem(List=deconstruct_brep.Faces, Index=Slider(4, range=0..10), Wrap=True)
division_7 = Division(A=unit_z, B=Slider(2, range=0..10))
line_2 = Line(StartPoint=divide_curve.Points, EndPoint=move_8.Geometry)  # -> flatten(Line)
shatter = Shatter(Curve=line, Parameters=divide_curve.Parameters)  # -> flatten(Segments)
move_9 = Move(Geometry=list_item, Motion=division_7)  # -> Geometry, Transform
deconstruct_brep_2 = DeconstructBrep(Brep=move_9.Geometry)  # -> Faces, Edges, Vertices
surface_curve = SurfaceCurve(Surface=move_9.Geometry, Curve=line_2)  # -> Curves, Points, UVPoints, Normals, Parameters, Tangents
shatter_2 = Shatter(Curve=line_2, Parameters=surface_curve.Parameters)  # -> simplify(Segments)
list_item_2 = ListItem(List=deconstruct_brep_2.Edges, Index=Slider(1, range=0..10), Wrap=True)
list_item_3 = ListItem(List=deconstruct_brep_2.Edges, Index=Slider(2, range=0..10), Wrap=True)
divide_curve_2 = DivideCurve(Curve=list_item_3, Count=number_slider_7, Kinks=False)  # -> Points, Tangents, Parameters
divide_curve_3 = DivideCurve(Curve=list_item_2, Count=number_slider_7, Kinks=False)  # -> Points, Tangents, Parameters
list_item_4 = ListItem(List=shatter_2, Index=0, Wrap=True)  # -> flatten(Item)
number_slider_9 = Slider(2, range=0..100)
panel_8 = Panel(number_slider_9)
text_join = TextJoin(Text=["CompisteIGriderBridgeSpans", panel_8])
structural_analysis_model = StructuralAnalysisModel(ProjectName=text_join, FileName=text_join, FilePath=panel, Editor="Hector, Posada C, UPC")
material = Material(
    IfcSA=structural_analysis_model,
    Name="C40/50",
    Description="Concrete for the deck slab",
    Category="concrete",
    PropertiesNames=panel_2,
    PropertiesValues=panel_4)  # -> IfcSA, Material
material_2 = Material(
    IfcSA=material.IfcSA,
    Name="S355",
    Description="Steel for the I-Shape griders",
    Category="steel",
    PropertiesNames=panel_5,
    PropertiesValues=panel_3)  # -> IfcSA, Material
material_3 = Material(
    IfcSA=material_2.IfcSA,
    Name="Rigid",
    Description="Rigid material for connectors",
    Category="steel",
    PropertiesNames=panel_7,
    PropertiesValues=panel_6)  # -> IfcSA, Material
i_section = ISection(
    IfcSA=material_3.IfcSA,
    Name="I-ShapeGirders",
    OverallWidth=division_6,
    OverallDepth=division_5,
    WebThickness=division_4,
    FlangeThickness=division_3)  # -> IfcSA, CrossSections, MechanicalPropertiesNames, MechanicalPropertiesValues
rectangular_section = RectangularSection(IfcSA=i_section.IfcSA, Name="Rigid", Widths="0.1", Depths="0.1")  # -> IfcSA, CrossSections, MechanicalPropertiesNames, MechanicalPropertiesValues
python_3_script_2 = Python3Script(
    srf=move_9.Geometry,
    pts=flatten([surface_curve.Points, divide_curve_3.Points, divide_curve_2.Points]),
    tol=Slider(0.001, range=0..0.001))  # -> cells; inputs srf: Surface, pts: list of Point3d, tol: Double
# ---------- python_3_script_2: Python ----------
"""
Divide a surface into a grid of rectangular subsurfaces (isotrim)
from an UNORDERED set of points lying on a regular UV grid,
with an extra subdivision inserted between rows (V axis).

Inputs
    srf : Surface / Brep (item)     -> surface to subdivide
    pts : Point3d (list)            -> unordered grid points on the surface
    tol : float (item, optional)    -> param clustering tol; leave empty/0 = auto

Outputs
    cells  : flat list of subsurfaces, row-major
    tree   : same cells, one branch per U-row (grid-structured)
    counts : [cells_U, cells_V]
"""

import Rhino.Geometry as rg

# optional tolerance input handled gracefully if the param doesn't exist
try:
    _tol = tol
except NameError:
    _tol = None


def to_surface(s):
    if isinstance(s, rg.Surface):
        return s
    if isinstance(s, rg.BrepFace):
        return s.UnderlyingSurface()
    if isinstance(s, rg.Brep):
        return s.Faces[0].UnderlyingSurface()
    return None


def cluster(values, domain_len, tol):
    """Group near-equal parameters into grid lines; return sorted centers."""
    sv = sorted(values)
    if tol is None or tol <= 0:
        eps = 1e-9 * max(domain_len, 1.0)
        gaps = [b - a for a, b in zip(sv, sv[1:]) if (b - a) > eps]
        spacing = min(gaps) if gaps else eps
        tol = 0.4 * spacing  # < smallest grid spacing, > numeric noise
    centers = []
    group = [sv[0]]
    for v in sv[1:]:
        if v - group[-1] <= tol:
            group.append(v)
        else:
            centers.append(sum(group) / len(group))
            group = [v]
    centers.append(sum(group) / len(group))
    return centers


def add_midlines(lines):
    """Insert a midpoint grid line between each consecutive pair."""
    refined = []
    for a, b in zip(lines, lines[1:]):
        refined.append(a)
        refined.append(0.5 * (a + b))
    refined.append(lines[-1])
    return refined


surface = to_surface(srf)

# 1) Project every point to (u, v) parameter space.
us, vs = [], []
for p in pts:
    ok, u, v = surface.ClosestPoint(p)
    if ok:
        us.append(u)
        vs.append(v)

# 2) Recover the grid lines by clustering u and v independently.
u_lines = cluster(us, surface.Domain(0).Length, _tol)
v_lines = cluster(vs, surface.Domain(1).Length, _tol)

# 2b) Extra division between rows (Y / V axis).
v_lines = add_midlines(v_lines)   # swap to u_lines if your rows stack along U

# 3) Isotrim one subsurface per cell between consecutive grid lines.
cells, rows = [], []
for i in range(len(u_lines) - 1):
    row = []
    u_int = rg.Interval(u_lines[i], u_lines[i + 1])
    for j in range(len(v_lines) - 1):
        v_int = rg.Interval(v_lines[j], v_lines[j + 1])
        sub = surface.Trim(u_int, v_int)
        if sub:
            cells.append(sub)
            row.append(sub)
    rows.append(row)

counts = [len(u_lines) - 1, len(v_lines) - 1]

# Expose grid-structured output as a DataTree (one branch per U-row).
try:
    from Grasshopper import DataTree
    from Grasshopper.Kernel.Data import GH_Path
    tree = DataTree[object]()
    for i, row in enumerate(rows):
        tree.AddRange(row, GH_Path(i))
except Exception:
    tree = cells
# ---------- end python_3_script_2 ----------
series_2 = Series(Start=0, Step=number_slider_7, Count=number_slider_9)
removeduplicatelines = RemoveDuplicateLines(Lines=list_item_4, Tolerance=0.01)
removeduplicatelines_2 = RemoveDuplicateLines(Lines=shatter, Tolerance=0.01)
unit_x_2 = UnitX(Factor=series_2)
panel_9 = Panel("C:\Users\UPCnet\OneDrive\MatchFEM_Examples\CompositeIGirderBridge")
move_10 = Move(Geometry=graft(python_3_script_2), Motion=unit_x_2)  # -> flatten(Geometry), Transform
move_11 = Move(Geometry=graft(removeduplicatelines), Motion=unit_x_2)  # -> flatten(Geometry), Transform
move_12 = Move(Geometry=graft(removeduplicatelines_2), Motion=unit_x_2)  # -> flatten(Geometry), Transform
frames = Frames(
    IfcSA=rectangular_section.IfcSA,
    Lines=move_12.Geometry,
    Material="S355",
    CrossSection="I-ShapeGirders",
    Type="RIGID_JOINED_MEMBER")  # -> IfcSA, NodesIDs, Nodes, FramesIDs, Frames, NodesLabels, FrameLabels
custom_preview = CustomPreview(Geometry=frames.Frames, Material=ColourSwatch(SwatchColor=RGB(0, 51, 255)))
removeduplicatelines_3 = RemoveDuplicateLines(Lines=move_11.Geometry, Tolerance=0.01)
frames_2 = Frames(IfcSA=frames.IfcSA, Lines=removeduplicatelines_3, Material="Rigid", CrossSection="Rigid", Type="RIGID_JOINED_MEMBER")  # -> IfcSA, NodesIDs, Nodes, FramesIDs, Frames, NodesLabels, FrameLabels
custom_preview_2 = CustomPreview(Geometry=frames_2.Frames, Material=ColourSwatch(SwatchColor=RGB(200, 224, 38)))
shells = Shells(IfcSA=frames_2.IfcSA, Surfaces=move_10.Geometry, Thickness=Slider(0.2, range=0..1), Material="C40/50", Type="SHELL")  # -> IfcSA, NodesIDs, Nodes, ShellsIDs, Shells, ShellsNodes, NodesLabels, ShellsLabels
custom_preview_3 = CustomPreview(Geometry=shells.Shells, Material=ColourSwatch(SwatchColor=RGBA(140, 32, 32, 157)))
ifc_sa_to_o_sam = IFCSAToOSAM(IfcSA=shells.IfcSA, FilePath=panel_9)  # -> OSAMFilePath, ConversionResults
